# Grasshopper definition stream_QLogs_Demo.gh (Grasshopper 1.0.7)
# plug-ins: Speckle 2

# STREAM_QUERY: LOGS (address below)
panel = Panel("https://speckle.xyz/streams/d96980ddc9/commits/b9b7f43ebe")
receive = Receive(
    Stream=panel,
    AutoReceive=False,
    CurrentComponentState="expired",
    ExpandOutput=True,
    ReceiveOnOpen=False,
    ReceivedCommitId="b9b7f43ebe",
    StreamWrapper="https://speckle.xyz/streams/d96980ddc9/commits/b9b7f43ebe",
    selectedKitName="Objects")  # -> Info, Data
dso = DeconstructSpeckleObject(SpeckleObject=receive.Data, selectedKitName="Objects")
data = Data(dso)
dso_2 = DeconstructSpeckleObject(SpeckleObject=simplify(data), selectedKitName="Objects")

# ---- group: scroll_through
number_slider = Slider(12, range=1..20)

# ----
dso_3 = DeconstructSpeckleObject(SpeckleObject=simplify(dso_2), selectedKitName="Objects")  # -> Dim, Type

python = GhPythonScript(stream_data=simplify(dso), y=number_slider)  # -> message, a; inputs stream_data: tree
# ---------- python: Python ----------
__author__ = "Amy Kim"
__version__ = "2023.02.06"

import rhinoscriptsyntax as rs


s = stream_data
limit = s.BranchCount

number = str(y)
a = '{' + number + '}'
# ---------- end python ----------
split = SplitTree(Data=simplify(dso), Masks=flatten(python.a))  # -> Positive, Negative
dso_4 = DeconstructSpeckleObject(SpeckleObject=split.Positive, selectedKitName="Objects")
panel_2 = Panel(dso_4)

# ----
# query by log length
dso_5 = DeconstructSpeckleObject(SpeckleObject=dso_3.Dim, selectedKitName="Objects")
panel_3 = Panel(dso_5)
smaller = SmallerThan(FirstNumber=dso_5, SecondNumber="700")  # -> SmallerThan, OrEqualTo
toggle = BooleanToggle(True)
dispatch = Dispatch(List=data, DispatchPattern=smaller.SmallerThan)  # -> ListA, ListB
clean = CleanTree(RemoveNulls=toggle, RemoveInvalid=toggle, RemoveEmpty=toggle, Tree=dispatch.ListB)
dso_6 = DeconstructSpeckleObject(SpeckleObject=simplify(clean), selectedKitName="Objects")  # -> Non_Geo, Stream_address
lng = ListLength(List=flatten(dso_6.Stream_address))
dso_7 = DeconstructSpeckleObject(SpeckleObject=simplify(dso_6.Non_Geo), selectedKitName="Objects")
item = ListItem(List=flatten(dso_6.Stream_address), Index=Slider(0, range=0..10), Wrap=True)

receive_2 = Receive(
    Stream=panel_2,
    AutoReceive=False,
    CurrentComponentState="expired",
    ExpandOutput=True,
    ReceiveOnOpen=False,
    ReceivedCommitId="5b1ba27015",
    StreamWrapper="https://speckle.xyz/streams/c7f47bbfc8/commits/fa5f4a81ef?u=6a481f614c",
    selectedKitName="Objects")  # -> Info, Data
dso_8 = DeconstructSpeckleObject(SpeckleObject=receive_2.Data, selectedKitName="Objects")
panel_4 = Panel(dso_7)
receive_3 = Receive(
    Stream=item,
    AutoReceive=False,
    CurrentComponentState="expired",
    ExpandOutput=True,
    ReceiveOnOpen=False,
    ReceivedCommitId="5b1ba27015",
    StreamWrapper="https://speckle.xyz/streams/c7f47bbfc8/commits/7ccecb7d35?u=6a481f614c",
    selectedKitName="Objects")  # -> Info, Data
dso_9 = DeconstructSpeckleObject(SpeckleObject=receive_3.Data, selectedKitName="Objects")

# ----
# query by log type
panel_5 = Panel("b0")
python_2 = GhPythonScript(x=dso_3.Type, condition=panel_5)  # -> out, a; inputs x: tree
# ---------- python_2: Python ----------
__author__ = "aimskim"
__version__ = "2023.06.13"

import rhinoscriptsyntax as rs
import ghpythonlib.treehelpers as th

condition = str(condition)
filtered = []
print(x)
for i in range(x.BranchCount):
    branchPath = x.Path(i)
    branchList = x.Branch(i)
    if branchList[0] == condition: 
        filtered.append(branchPath)
        print(branchPath)

    else: 
        pass

a = [i for i in filtered]
# ---------- end python_2 ----------
split_2 = SplitTree(Data=data, Masks=flatten(python_2.a))  # -> Positive, Negative
panel_6 = Panel(python_2.a)
dso_10 = DeconstructSpeckleObject(SpeckleObject=simplify(split_2.Negative), selectedKitName="Objects")  # -> _3D_Crvs, Non_Geo, Stream_address
dso_11 = DeconstructSpeckleObject(SpeckleObject=simplify(dso_10.Non_Geo), selectedKitName="Objects")

dso_12 = DeconstructSpeckleObject(SpeckleObject=simplify(dso_10._3D_Crvs), selectedKitName="Objects")  # -> Center, Diameter
lng_2 = ListLength(List=flatten(dso_10.Stream_address))
item_2 = ListItem(List=flatten(dso_10.Stream_address), Index=0, Wrap=True)

crv = Curve(dso_12.Center)
crv_2 = Curve(dso_12.Diameter)

panel_7 = Panel(dso_11)
receive_4 = Receive(
    Stream=item_2,
    AutoReceive=False,
    CurrentComponentState="expired",
    ExpandOutput=True,
    ReceiveOnOpen=False,
    ReceivedCommitId="c6e8e8c6ee",
    StreamWrapper="https://speckle.xyz/streams/c7f47bbfc8/commits/c6e8e8c6ee?u=6a481f614c",
    selectedKitName="Objects")  # -> Info, Data
dso_13 = DeconstructSpeckleObject(SpeckleObject=receive_4.Data, selectedKitName="Objects")
