# Grasshopper definition stream_QOffcuts_Demo.gh (Grasshopper 1.0.7)
# plug-ins: Speckle 2

# STREAM_QUERY: LOGS (address below)
panel = Panel("https://speckle.xyz/streams/fb225b10ff")
receive = Receive(
    Stream=panel,
    AutoReceive=False,
    CurrentComponentState="expired",
    ExpandOutput=True,
    LastInfoMessage="Amy Where @ 06/25/2023 15:23:58:  June 25th 2023 (17:23:36) (id:4f84afd0b6)",
    ReceiveOnOpen=False,
    ReceivedCommitId="4f84afd0b6",
    StreamWrapper="https://speckle.xyz/streams/fb225b10ff",
    selectedKitName="Objects")  # -> Info, Data
dso = DeconstructSpeckleObject(SpeckleObject=receive.Data, selectedKitName="Objects")
data = Data(dso)
dso_2 = DeconstructSpeckleObject(SpeckleObject=simplify(data), selectedKitName="Objects")  # -> _2D_Crvs, Non_Geo, Stream_address
dso_3 = DeconstructSpeckleObject(SpeckleObject=simplify(dso_2.Non_Geo), selectedKitName="Objects")  # -> _id, Color, Date_received, Dim, Location, Type
dso_4 = DeconstructSpeckleObject(SpeckleObject=dso_3.Dim, selectedKitName="Objects")  # -> L, Th, W

# ----
# query for planed
panel_2 = Panel("p2")
data_2 = Data(dso_3.Type)
python = GhPythonScript(x=data_2, condition=panel_2)  # -> out, a; inputs x: tree
# ---------- python: Python ----------
__author__ = "aimskim"
__version__ = "2023.06.13"

import rhinoscriptsyntax as rs
import ghpythonlib.treehelpers as th

condition = str(condition)
filtered = []
print(x)
for i in range(x.BranchCount):
    branchPath = x.Path(i)
    branchList = x.Branch(i)
    if branchList[0] == condition: 
        filtered.append(branchPath)
        print(branchPath)

    else: 
        pass

a = [i for i in filtered]
# ---------- end python ----------
split = SplitTree(Data=data, Masks=flatten(python.a))  # -> Positive, Negative
data_3 = Data(split.Positive)
dso_5 = DeconstructSpeckleObject(SpeckleObject=simplify(data_3), selectedKitName="Objects")  # -> _2D_Crvs, Non_Geo, Stream_address
dso_6 = DeconstructSpeckleObject(SpeckleObject=simplify(dso_5.Non_Geo), selectedKitName="Objects")  # -> _id, Color, Date_received, Dim, Location, Type

# ----
# query by thickness
dso_7 = DeconstructSpeckleObject(SpeckleObject=simplify(dso_6.Dim), selectedKitName="Objects")  # -> L, Th, W
data_4 = Data(dso_7.Th)
smaller = SmallerThan(FirstNumber=Slider(26.9, range=5..50), SecondNumber=data_4)  # -> SmallerThan, OrEqualTo
dispatch = Dispatch(List=data_3, DispatchPattern=smaller.OrEqualTo)  # -> ListA, ListB
toggle = BooleanToggle(True)
clean = CleanTree(RemoveNulls=toggle, RemoveInvalid=toggle, RemoveEmpty=toggle, Tree=dispatch.ListA)
data_5 = Data(clean)
dso_8 = DeconstructSpeckleObject(SpeckleObject=simplify(data_5), selectedKitName="Objects")  # -> _2D_Crvs, Non_Geo, Stream_address
dso_9 = DeconstructSpeckleObject(SpeckleObject=simplify(dso_8.Non_Geo), selectedKitName="Objects")  # -> _id, Color, Date_received, Dim, Location, Type
data_6 = Data(flatten(dso_8.Stream_address))
item = ListItem(List=data_6, Index=Slider(0, range=0..10), Wrap=True)

panel_3 = Panel(dso_6.Type)
python_2 = GhPythonScript(stream_data=simplify(dso_9._id))  # -> flatten(message), flatten(filter); inputs stream_data: tree
# ---------- python_2: Python ----------
__author__ = "Amy Kim"
__version__ = "2023.02.06"

import rhinoscriptsyntax as rs


s = stream_data
filtered_amt = s.BranchCount

filtered_id = []

for i in range(s.BranchCount):
    filtered = s.Branch(i)
    filtered_id.append(filtered[0])

message = ("%i items" % int(filtered_amt))
filter = filtered_id
# ---------- end python_2 ----------
receive_2 = Receive(
    Stream=item,
    AutoReceive=False,
    CurrentComponentState="expired",
    ExpandOutput=True,
    ReceiveOnOpen=False,
    ReceivedCommitId="5b1ba27015",
    StreamWrapper="https://speckle.xyz/streams/c7f47bbfc8/commits/7d9f7589de?u=6a481f614c",
    selectedKitName="Objects")  # -> Info, Data
dso_10 = DeconstructSpeckleObject(SpeckleObject=receive_2.Data, selectedKitName="Objects")
panel_4 = Panel(python_2.message)
panel_5 = Panel(dso_9.Type)

# ----
# VISUALIZE
dso_11 = DeconstructSpeckleObject(SpeckleObject=dso_8._2D_Crvs, selectedKitName="Objects")  # -> Inner_border, Outline
dso_12 = DeconstructSpeckleObject(SpeckleObject=dso_9.Color, selectedKitName="Objects")  # -> Bark, Wood
python_3 = GhPythonScript(y=Slider(21, range=1..35))  # -> out, a
# ---------- python_3: Python ----------
__author__ = "aimskim"
__version__ = "2023.06.25"

import rhinoscriptsyntax as rs

item = y
filter = '{%i}'%item
print(filter)
# ---------- end python_3 ----------
split_2 = SplitTree(Data=simplify([dso_11.Outline, dso_11.Inner_border]), Masks=flatten(python_3.out))  # -> Positive, Negative
crv = Curve(split_2.Positive)
split_3 = SplitTree(Data=simplify(dso_12.Bark), Masks=flatten(python_3.out))  # -> Positive, Negative
split_4 = SplitTree(Data=simplify(dso_12.Wood), Masks=flatten(python_3.out))  # -> Positive, Negative
item_2 = ListItem(List=simplify(split_3.Positive), Index=0, Wrap=True)  # -> Item, Item1, Item2
item_3 = ListItem(List=simplify(split_4.Positive), Index=0, Wrap=True)  # -> Item, Item1, Item2
expression = Expression(x=item_2.Item1, y="-0.5", Expression="x-y")
expression_2 = Expression(x=item_2.Item2, y="0.1", Expression="x-y")
expression_3 = Expression(x=item_3.Item1, y="-0.5", Expression="x-y")
expression_4 = Expression(x=item_3.Item2, y="0.1", Expression="x-y")
srf = Surface(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)
srf_2 = Surface(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)
hsv = ColourHSV(Alpha=1, Hue=item_2.Item, Saturation=expression, Value=expression_2)
hsv_2 = ColourHSV(Alpha=1, Hue=item_3.Item, Saturation=expression_3, Value=expression_4)
preview = CustomPreview(Geometry=srf, Material=hsv)
preview_2 = CustomPreview(Geometry=srf_2, Material=hsv_2)

pt = Point()
